vi "InitVocabArray.gvi"   [LabVIEW NXG 3.1.0]
inputs:
  "text from File": string
  "Error In": error
outputs:
  "VocabArray": "VocabWord.gtype"[]
  "Error Out": error
diagram:
  Spreadsheet String To Array(array type=string[][] [], delimiter=",", format string="%s", spreadsheet string=$"text from File") -> (array=w1)
  s1 = "VocabWord.gtype"[] []  # shift register
  for {
    w2 = each element of w1
    Array Index(array=w2) -> (out0[_]=w3, out1[_]=w4, out2[_]=w5)
    String To Path(string=w5) -> (path=w6)
    Property Node(instance in="VocabWord.gtype" constant, "Word"=w3, "Definition"=w4, "Resource Link"=w6) -> (instance out=w7)
    Insert Into Array(inArray=s1, new=w7) -> w8
    next s1 = w8
  }
  $VocabArray <- s1
