vi "Main.gvi"   [LabVIEW NXG 3.1.0]
panel controls:
  "Stop": bool
  "Open Link": bool
  "Word Index": i32
  "Random Word": bool
  "Save": bool
  "Definition": string
  "Word": string
  "Resource Link": path
  "Insert Word": bool
panel indicators:
  "# Vocab Words Stored": i32
  "Header (Current Mode)": string
types:
  "StateData.gtype" = cluster{"Vocab Words": "VocabWord.gtype"[], "Word Controls": "Control reference"[], "CSV Path": path}
uses:
  NI::G Core::URL::Open URL in Default Browser (path).gvi
  NI::G Core::Error::Display Error.gvi
  NI::G Core::Error::Clear Error Cluster.gvi
  NI::G Core::Numeric::Random Number (Range) DBL.gvi
diagram:
  w1 = "Init"  # Program State
  w2 = no error  # Error
  s1 = w1  # shift register
  s2 = w2  # shift register
  s3 = "StateData.gtype" {all zero or empty}  # shift register
  while {
    # w3: State
    # s1: State
    # w4: Close?
    case (s2) {
      frame Error, Default {
        Property Node(instance in=s2) -> ("source"=w7, "code"=w8)
        Format Into String(initString="(Error %d) - %s \\n\\n The program will now close.", w8, w7) -> w9
        One Button Dialog(message=w9) -> (true=w4)
        w5 = s3
        w3 = s1
        w6 = s2
      }
      frame No Error {
        case (s1) {
          frame "Init" {
            $"Header (Current Mode)" <- "Manual Mode"
            Build Array(reference to "Word", reference to "Definition", reference to "Resource Link", reference to "Save") -> w10
            call "EnableWordEdit.gvi"(Array of Control References=w10, Enable?=FALSE, Error In=s2) -> (Array of Control References Out=w11, Error Out=w12)
            Get Component Directory() -> (Path=w13)
            Build Path(base path=w13, name or relative path=path "VocabWords.csv") -> (appended path=w14)
            Open Or Create Or Replace File(error in=w12, file path (use dialog)=w14, operation (0:open)="open or create") -> (error out=w15, refnum out=w16)
            Read From Text File(error in=w15, file (use dialog)=w16) -> (error out=w17, refnum out=w18, text=w19)
            Close File(error in=w17, refnum=w18) -> (error out=w20, path=w21)
            call "InitVocabArray.gvi"(text from File=w19, Error In=w20) -> (VocabArray=w22, Error Out=w23)
            Property Node(instance in=s3, "Vocab Words"=w22, "Word Controls"=w11, "CSV Path"=w21) -> (instance out=w5)
            w24 = "Wait For Event"  # Program State
            Array Size(array=w22) -> (size(s)=w25)
            $"# Vocab Words Stored" <- w25
            Is Greater Than 0(x=w25) -> w26
            case (w26) {
              frame False, Default {
                $Definition <- ""
                String To Path(string="") -> (path=w27)
                $"Resource Link" <- w27
                $Word <- "Insert a vocab word to get started!"
                w6 = w23
              }
              frame True {
                Array Index(array=w22) -> (out0[0]=w28)
                Property Node(instance in=w28, error in=w23) -> ("Word"=w29, "Definition"=w30, "Resource Link"=w31, error out=w6)
                $"Resource Link" <- w31
                $Word <- w29
                $Definition <- w30
              }
            }
            w3 = w24
            w4 = FALSE
          }
          frame "Wait For Event", Default {
            event (after s1) {
              on "Word Index" Value changed {
                $"Random Word" <- FALSE
                $"Insert Word" <- FALSE
                w32 = "Wait For Event"  # Program State
                Property Node(instance in=s3) -> ("Vocab Words"=w33, "Word Controls"=w34, instance out=w5)
                call "EnableWordEdit.gvi"(Array of Control References=w34, Enable?=FALSE, Error In=s2) -> (Error Out=w35)
                Array Size(array=w33) -> (size(s)=w36)
                Is Greater Than 0(x=w36) -> w37
                case (w37) {
                  frame False, Default {
                    $Word <- "Insert a vocab word to get started!"
                    w6 = w35
                  }
                  frame True {
                    Array Index(array=w33) -> (out0[$"Word Index"]=w38)
                    Property Node(instance in=w38, error in=w35) -> ("Word"=w39, "Definition"=w40, "Resource Link"=w41, error out=w6)
                    $Word <- w39
                    $Definition <- w40
                    $"Resource Link" <- w41
                  }
                }
                $"Header (Current Mode)" <- "Manual Mode"
                w3 = w32
                w4 = FALSE
              }
              on "Stop" Value changed {
                Event Data() -> ("New Value"=w4)
                w42 = "Exit"  # Program State
                $"Header (Current Mode)" <- "Program stopping..."
                w3 = w42
                w6 = s2
                w5 = s3
              }
              on "Save" Value changed {
                $"Header (Current Mode)" <- "Saving new word..."
                w43 = "Insert"  # Program State
                w3 = w43
                w6 = s2
                w5 = s3
                w4 = FALSE
              }
              on "Random Word" Value changed {
                $"Header (Current Mode)" <- "Random Mode"
                w3 = "Random"
                w6 = s2
                w5 = s3
                w4 = FALSE
              }
              on "Insert Word" Value changed {
                $"Header (Current Mode)" <- "Insert Mode"
                Property Node(instance in=s3) -> ("Word Controls"=w44)
                call "EnableWordEdit.gvi"(Array of Control References=w44, Enable?=TRUE, Error In=s2) -> (Error Out=w45)
                Property Node(instance in=reference to "Word", "KeyFocus"=TRUE, error in=w45) -> (error out=w46, instance out=w47)
                Close Reference(error in=w46, reference=w47) -> (error out=w6)
                $"Resource Link" <- path ""
                $Definition <- ""
                $Word <- ""
                w3 = "Wait For Event"
                w5 = s3
                w4 = FALSE
              }
              on "Open Link" Value changed {
                call "Open URL in Default Browser (path).gvi"(path=$"Resource Link", error in=s2) -> (error out=w48)
                call "Display Error.gvi"(error in=w48)
                call "Clear Error Cluster.gvi"(error in=w48) -> (error out=w6)
                w3 = default
                w5 = s3
                w4 = default
              }
            }
          }
          frame "Random" {
            w49 = "Wait For Event"  # Program State
            Property Node(instance in=s3) -> ("Vocab Words"=w50)
            Array Size(array=w50) -> (size(s)=w51)
            Is Greater Than 0(x=w51) -> w52
            case (w52) {
              frame False, Default {
                w6 = s2
              }
              frame True {
                call "Random Number (Range) DBL.gvi"(upper bound=w51, lower bound=0) -> (number=w53)
                Round To Nearest(number=w53) -> w54
                To Long Integer(number=w54) -> w55
                Property Node(instance in=reference to "Word Index", "Value"=w55, error in=s2) -> (error out=w56)
                Array Index(array=w50) -> (out0[w55]=w57)
                Property Node(instance in=w57, error in=w56) -> ("Word"=w58, "Definition"=w59, "Resource Link"=w60, error out=w6)
                $Word <- w58
                $Definition <- w59
                $"Resource Link" <- w60
              }
            }
            w3 = w49
            w4 = FALSE
            w5 = s3
          }
          frame "Insert" {
            # Only happens once "Save" is pressed
            $"Header (Current Mode)" <- "Manual Mode"
            w61 = "Wait For Event"  # Program State
            Property Node(instance in=s3) -> ("CSV Path"=w62, "Vocab Words"=w63, instance out=w64)
            Array Size(array=w63) -> (size(s)=w65)
            Is Equal To 0(x=w65) -> w66
            Select(s=w66, t="", f=",") -> w67
            Open Or Create Or Replace File(error in=s2, file path (use dialog)=w62) -> (error out=w68, refnum out=w69)
            Read From Text File(error in=w68, file (use dialog)=w69) -> (error out=w70, refnum out=w71, text=w72)
            Path To String(path=$"Resource Link") -> (string=w73)
            Concatenate Strings(w72, w67, $Word, ",", $Definition, ",", w73) -> w74
            call "InitVocabArray.gvi"(text from File=w74) -> (VocabArray=w75)
            Property Node(instance in=w64, "Vocab Words"=w75) -> (instance out=w5)
            Array Size(array=w75) -> (size(s)=w76)
            Decrement(x=w76) -> w77
            Array Index(array=w75) -> (out0[w77]=w78)
            Property Node(instance in=w78) -> ("Word"=w79, "Definition"=w80, "Resource Link"=w81)
            $Word <- w79
            $Definition <- w80
            $"Resource Link" <- w81
            Write To Text File(error in=w70, file (use dialog)=w71, text=w74) -> (error out=w82, refnum out=w83)
            Close File(error in=w82, refnum=w83) -> (error out=w6)
            $"# Vocab Words Stored" <- w76
            w3 = w61
            w4 = FALSE
          }
          frame "Exit" {
            w84 = "Exit"  # Program State
            w6 = s2
            w3 = w84
            w4 = TRUE
            w5 = s3
          }
        }
      }
    }
    next s1 = w3
    next s2 = w6
    next s3 = w5
    stop if w4
  }
